# Grasshopper definition 220118-assignment1-clemens-shelf.gh (Grasshopper 1.0.7)
# plug-ins: Hops

length = Slider(300, range=0..1000)
height = Slider(200, range=0..500)
number_slider = Slider(0.1, range=0..0.1)
shelf_height_insert_a_nr_in_cm = GetNumber(height, AtLeast=1, AtMost=1, Maximum=1.797693135e+308, Minimum=-1.797693135e+308)
shelf_length_insert_a_nr_in_cm = GetNumber(length, AtLeast=1, AtMost=1, Maximum=1.797693135e+308, Minimum=-1.797693135e+308)
xz_plane = XZPlane(Origin=Point(0, 0, 0))
multiplication = Multiplication(A=shelf_length_insert_a_nr_in_cm, B=number_slider)
multiplication_2 = Multiplication(A=shelf_height_insert_a_nr_in_cm, B=number_slider)
plane_surface = PlaneSurface(Plane=xz_plane, XSize=shelf_length_insert_a_nr_in_cm, YSize=shelf_height_insert_a_nr_in_cm)
divide_surface = DivideSurface(Surface=plane_surface, UCount=multiplication, VCount=multiplication_2)  # -> Points, Normals, Parameters
deconstruct = Deconstruct(Point=divide_surface.Points)  # -> XComponent, YComponent, ZComponent
formtype_insertnr_0_1_0_4 = GetNumber(Slider(0.1, range=-0.6..0.4), AtLeast=1, AtMost=1, Maximum=1.797693135e+308, Minimum=-1.797693135e+308)
division = Division(A=deconstruct.XComponent, B=formtype_insertnr_0_1_0_4)
division_2 = Division(A=deconstruct.ZComponent, B=formtype_insertnr_0_1_0_4)
material_thickness = Slider(30, range=0..100)
sine = Sine(Value=division)
cosine = Cosine(Value=division_2)
multiplication_3 = Multiplication(A=sine, B=cosine)
set_a_shelf_depth_in_cm = GetNumber(material_thickness, AtLeast=1, AtMost=1, Maximum=1.797693135e+308, Minimum=-1.797693135e+308)
multiplication_4 = Multiplication(A=multiplication_3, B=Slider(15, range=10..25))
addition = Addition(A=multiplication_4, B=set_a_shelf_depth_in_cm)
negative = Negative(Value=addition)
construct_point = ConstructPoint(XCoordinate=deconstruct.XComponent, YCoordinate=negative, ZCoordinate=deconstruct.ZComponent)
construct_point_2 = ConstructPoint(XCoordinate=deconstruct.XComponent, YCoordinate=negative, ZCoordinate=deconstruct.ZComponent)
surface_from_points = SurfaceFromPoints(Points=flatten(construct_point), UCount=expr("x+1", multiplication), Interpolate=False)
project = Project(Geometry=surface_from_points, Plane=xz_plane)  # -> Geometry, Transform
curve = Curve(surface_from_points)
weave = Weave(Pattern=[0, 1], Stream0=curve, Stream1=project.Geometry, NullGaps=False)
loft = Loft(Curves=weave, Options={Adjust=False, Closed=False, LoftEnds=0, LoftSimp=0, LoftType=0, Rebuild=10, Refit=0.01})
merge = Merge(Data1=plane_surface, Data2=loft, Data3=surface_from_points)
brep_join = BrepJoin(Breps=merge)  # -> Breps, Closed
unit_z = UnitZ(Factor=1)
unit_x = UnitX(Factor=1)
division_type_nr_from_5_30 = GetInteger(Slider(15, range=0..100), AtLeast=1, AtMost=1, Maximum=2147483647, Minimum=-2147483648)

bounding_box = BoundingBox(Content=brep_join.Breps, Plane=PlaneXY(0, 0, 0))  # -> Box, Box_2
deconstruct_brep = DeconstructBrep(Brep=bounding_box.Box)  # -> Faces, Edges, Vertices
multiplication_5 = Multiplication(A=Slider(0.075, range=0..0.1), B=Slider(4, range=0..10))
list_item = ListItem(List=deconstruct_brep.Edges, Index=0, Wrap=True)
unit_x_2 = UnitX(Factor=multiplication_5)
end_points = EndPoints(Curve=list_item)  # -> Start, End
move = Move(Geometry=end_points.Start, Motion=unit_x_2)  # -> Geometry, Transform; disabled
move_2 = Move(Geometry=end_points.Start, Motion=unit_x_2)  # -> Geometry, Transform; disabled

contour = Contour(Shape=brep_join.Breps, Point=end_points.Start, Direction=unit_x, Distance=division_type_nr_from_5_30)  # -> flatten(Contours)
contour_2 = Contour(Shape=brep_join.Breps, Point=end_points.Start, Direction=unit_z, Distance=division_type_nr_from_5_30)  # -> flatten(Contours)
number_slider_2 = Slider(2.5, range=0..10)

number_slider_3 = Slider(0, range=0..100)
cull_index = CullIndex(List=contour, Indices=number_slider_3, Wrap=True)  # -> reverse(List)
cull_index_2 = CullIndex(List=cull_index, Indices=number_slider_3, Wrap=True)

number_slider_4 = Slider(0, range=0..100)
cull_index_3 = CullIndex(List=contour_2, Indices=number_slider_4, Wrap=True)  # -> reverse(List)
cull_index_4 = CullIndex(List=cull_index_3, Indices=number_slider_4, Wrap=True)

unit_x_3 = UnitX(Factor=number_slider_2)
move_3 = Move(Geometry=cull_index_2, Motion=unit_x_3)  # -> Geometry, Transform
unit_z_2 = UnitZ(Factor=number_slider_2)
move_4 = Move(Geometry=cull_index_4, Motion=unit_z_2)  # -> Geometry, Transform
negative_2 = Negative(Value=unit_x_3)
surface = Surface(move_3.Geometry)
negative_3 = Negative(Value=unit_z_2)
surface_2 = Surface(move_4.Geometry)
extrude = Extrude(Base=surface, Direction=negative_2)
extrude_2 = Extrude(Base=surface_2, Direction=negative_3)
geometry = Geometry([extrude, extrude_2])
context_bake = ContextBake(Geometry=geometry)
custom_preview = CustomPreview(
    Geometry=geometry,
    Material={diffuse=RGB(221, 160, 221), emission=RGB(66, 48, 66), shine=0.5, specular=RGB(255, 255, 255), transparency=0})
hops = Hops(
    CacheResultsInMemory=True,
    CacheSolveResults=True,
    RemoteSolveVersion=(0, 1, 0),
    ShowInput_Enabled=False,
    ShowInput_Path=False,
    SynchronousSolve=True)
